# Grasshopper definition 3.2 - Site Analysis.gh (Grasshopper 0.9.69)
# plug-ins: Python Interpreter

file_path = Panel("C:\Users\cesandoval\Dropbox\Grasshopper Workshop\GIS\")
file_name = Panel("Site.shp")
file_name_2 = Panel("parcels.shp")
file_name_3 = Panel("buildings_height.shp")
concat = Concatenate(A=file_path, B=file_name)
concat_2 = Concatenate(A=file_path, B=file_name_2)
concat_3 = Concatenate(A=file_path, B=file_name_3)
# Import the GIS layers
readshapefile = ReadShapefile(shapefile=concat, read=Toggle(True))  # -> out, geometry
# ---------- readshapefile: Python ----------
import os
import sys
import System.Text
bodyname = System.Text.Encoding.Default.BodyName
sys.setdefaultencoding(bodyname)

import struct, datetime, decimal, itertools
from struct import unpack
import Rhino

def dbfreader(f):
    """Returns an iterator over records in a Xbase DBF file.

    The first row returned contains the field names.
    The second row contains field specs: (type, size, decimal places).
    Subsequent rows contain the data records.
    If a record is marked as deleted, it is skipped.

    File should be opened for binary reads.

    """
    # See DBF format spec at:
    #     http://www.pgts.com.au/download/public/xbase.htm#DBF_STRUCT

    numrec, lenheader = struct.unpack('<xxxxLH22x', f.read(32))    
    numfields = (lenheader - 33) // 32

    fields = []
    for fieldno in xrange(numfields):
        name, typ, size, deci = struct.unpack('<11sc4xBB14x', f.read(32))
        name = name.replace('\0', '')       # eliminate NULs from string   
        fields.append((name, typ, size, deci))
    yield [field[0] for field in fields]
    yield [tuple(field[1:]) for field in fields]

    terminator = f.read(1)
    assert terminator == '\r'

    fields.insert(0, ('DeletionFlag', 'C', 1, 0))
    fmt = ''.join(['%ds' % fieldinfo[2] for fieldinfo in fields])
    fmtsiz = struct.calcsize(fmt)
    for i in xrange(numrec):
        record = struct.unpack(fmt, f.read(fmtsiz))
        #print record#[:4]
        if record[0] != ' ':
            continue                        # deleted record
        result = []
        for (name, typ, size, deci), value in itertools.izip(fields, record):
            if name == 'DeletionFlag':
                continue
            if typ == "N":
                value = value.replace('\0', '').lstrip()
                if value == '':
                    value = 0
                elif deci:
                    value = decimal.Decimal(value)
                else:
                    value = int(value)
            elif typ == 'D':
                #print type(value[:4]), type(value[4:6]), type(value[6:8])
                try:
                    y, m, d = int(value[:4]), int(value[4:6]), int(value[6:8])
                    value = datetime.date(y, m, d)
                    print value
                except:
                    value = datetime.date(1,1,1)
                    print "We couldn't get a date for a geometry in your dbf"
            elif typ == 'L':
                value = (value in 'YyTt' and 'T') or (value in 'NnFf' and 'F') or '?'
            result.append(value)
        yield result
        
##########################################################################

class ShpFeature(object):
    '''
    This is a base class for each record in a shapefile.
    each record corresponds to one row in the shapefile's dbf table.
    To clarify the distinction between a feature and a record:
    the record is the feature + the dbf data associated with the feature
    the feature is shape (or multi-shape)
    In this class, I attach the dbf data for each record to it's feature.
    '''

    def __init__(self, shpFile, recordNumber):
        self.shpFile = shpFile
        self.recordNumber = recordNumber
        self.shapeType = shpFile.shapeType
        self.dbfData = self.readDbfData()

    def readDbfData(self):
        db = self.shpFile.dbfTable
        dbfData = {}
        for i in range(len(db[0])): # for each column
                dbfData[db[0][i]] = db[self.recordNumber + 2][i]
        return dbfData

    def make3D(self, zVals=None):
        """
        This method will take a list of z values and use them to create a new
        attribute called points3D, which contains 3d points. ESRI shapefiles
        place z values in a separate list form x and y values for each point,
        so this essentially integrates those values to make full 3d points.
        If the number of z values does not match the number of points,
        then this method will not work.
        This method will overwrite the points3d attribute if it already exists.
        """
        # if there's not enough z values for the number of points
        # or not enough points for the number of z values
        if not zVals:
            zVals = [0 for i in range(self.numPoints)]
        if len(zVals) != self.numPoints:
            print "The number of Z values does not correspond to the number of points."
            return
        # clear points3D
        self.points3D = []
        for i in range(len(zVals)):
            z = zVals[i]
            x = self.points[i][0]
            y = self.points[i][1]
            point3d = (x,y,z)
            self.points3D.append(point3d)

    def chopParts(self, partlist, pointlist):
        if type(partlist) == tuple:
            indexSpread = list(partlist)
        elif type(partlist) == list:
            indexSpread = partlist
        else:
            indexSpread = [partlist]
        indexSpread.append(len(pointlist))
        chunks = []
        for i in range(len(indexSpread) - 1):
            chunks.append(pointlist[indexSpread[i]:indexSpread[i+1]])
        return chunks

class ShpPoint(ShpFeature):

    def __init__(self, ShpFile, recordNumber):
        ShpFeature.__init__(self, ShpFile, recordNumber)
        self.parts = [0]
        self.numParts = 1
        self.numPoints = 1
        self.points = [self.shpFile._readPoint()]
        self.x = self.points[0][0]
        self.y = self.points[0][1]
        self.make3D()

class ShpPointM(ShpPoint):
    def __init__(self,ShpFile, recordNumber):

        ShpPoint.__init__(self, ShpFile, recordNumber)

        self.m = self.shpFile._readZ()
        self.make3D()

class ShpPointZ(ShpPoint):
    def __init__(self,ShpFile, recordNumber):

        ShpPoint.__init__(self, ShpFile, recordNumber)

        self.z = self.shpFile._readZ()
        self.m = self.shpFile._readZ()
        self.make3D([self.z])

class ShpMultiPoint(ShpFeature):

    def __init__(self,ShpFile, recordNumber):

        ShpFeature.__init__(self, ShpFile, recordNumber)
        self.parts[0]
        self.numParts = 1
        self.boundingBox = self.shpFile._readBoundingBox()
        self.numPoints = self.shpFile._readNumPoints()
        self.points = self.shpFile._readPoints(self.numPoints)
        self.make3D()

class ShpMultiPointM(ShpMultiPoint):

    def __init__(self,ShpFile, recordNumber):

        ShpMultiPoint.__init__(self, ShpFile, recordNumber)
        self.mBounds = self.shpFile._readZBounds()
        self.mArray = self.shpFile._readZArray(self.numPoints)
        self.make3D()

class ShpMultiPointZ(ShpMultiPoint):

    def __init__(self,ShpFile, recordNumber):

        ShpMultiPoint.__init__(self, ShpFile, recordNumber)
        self.zBounds = self.shpFile._readZBounds()
        self.zArray = self.shpFile._readZArray(self.numPoints)
        self.mBounds = self.shpFile._readZBounds()
        self.mArray = self.shpFile._readZArray(self.numPoints)
        self.make3D(self.zArray)

class ShpPolyLine(ShpFeature):

    def __init__(self,ShpFile, recordNumber):

        ShpFeature.__init__(self, ShpFile, recordNumber)

        self.boundingBox = self.shpFile._readBoundingBox()
        self.numParts = self.shpFile._readNumParts()
        self.numPoints = self.shpFile._readNumPoints()
        self.parts = self.shpFile._readParts(self.numParts)
        self.points = self.shpFile._readPoints(self.numPoints)
        self.make3D()

class ShpPolyLineM(ShpPolyLine):

    def __init__(self,ShpFile, recordNumber):

        ShpPolyLine.__init__(self, ShpFile, recordNumber)

        self.mBounds = self.shpFile._readZBounds()
        self.mArray = self.shpFile._readZArray(self.numPoints)
        self.make3D()

class ShpPolyLineZ(ShpPolyLine):

    def __init__(self,ShpFile, recordNumber):

        ShpPolyLine.__init__(self, ShpFile, recordNumber)

        self.zBounds = self.shpFile._readZBounds()
        self.zArray = self.shpFile._readZArray(self.numPoints)
        self.mBounds = self.shpFile._readZBounds()
        self.mArray = self.shpFile._readZArray(self.numPoints)
        self.make3D(self.zArray)

class ShpPolygon(ShpFeature):

    def __init__(self,ShpFile, recordNumber):

        ShpFeature.__init__(self, ShpFile, recordNumber)

        self.boundingBox = self.shpFile._readBoundingBox()
        self.numParts = self.shpFile._readNumParts()
        self.numPoints = self.shpFile._readNumPoints()
        self.parts = self.shpFile._readParts(self.numParts)
        self.points = self.shpFile._readPoints(self.numPoints)
        self.make3D()

class ShpPolygonM(ShpPolygon):

    def __init__(self,ShpFile, recordNumber):

        ShpPolygon.__init__(self, ShpFile, recordNumber)

        self.mBounds = self.shpFile._readZBounds()
        self.mArray = self.shpFile._readZArray(self.numPoints)
        self.make3D()

class ShpPolygonZ(ShpPolygon):

    def __init__(self,ShpFile, recordNumber):

        ShpPolygon.__init__(self, ShpFile, recordNumber)

        self.zBounds = self.shpFile._readZBounds()
        self.zArray = self.shpFile._readZArray(self.numPoints)
        self.mBounds = self.shpFile._readZBounds()
        self.mArray = self.shpFile._readZArray(self.numPoints)
        self.make3D(self.zArray)

class ShpMultiPatch(ShpFeature):

    def __init__(self, ShpFile, recordNumber):

        ShpFeature.__init__(self, ShpFile, recordNumber)

        self.boundingBox = self.shpFile._readBoundingBox()
        self.numParts = self.shpFile._readNumParts()
        self.numPoints = self.shpFile._readNumPoints()
        self.parts = self.shpFile._readParts(self.numParts)
        self.partTypes = self.shpFile._readParts(self.numParts)
        self.points = self.shpFile._readPoints(self.numPoints)
        self.zBounds = self.shpFile._readZBounds()
        self.zArray = self.shpFile._readZArray(self.numPoints)
        self.mBounds = self.shpFile._readZBounds()
        self.mArray = self.shpFile._readZArray(self.numPoints)
        self.make3D(self.zArray)
        #self.points = [self.shpFile._readPoint()]

##################################################

def readAndUnpack(type, data):
    if data=='': return data
    return unpack(type, data)[0]

shapeTypeDict = {
                 0:'Null Shape',
                 1:'Point',
                 3:'PolyLine',
                 5:'Polygon',
                 8:'MultiPoint',
                 11:'PointZ',
                 13:'PolyLineZ',
                 15:'PolygonZ',
                 18:'MultiPointZ',
                 21:'PointM',
                 23:'PolyLineM',
                 25:'PolygonM',
                 28:'MultiPointM',
                 31:'MultiPatch'
                 }

classTypeDict = {
                'Point':ShpPoint,
                'PointM':ShpPointM,
                'PointZ':ShpPointZ,
                'MultiPoint':ShpMultiPoint,
                'MultiPointM':ShpMultiPointM,
                'MultiPointZ':ShpMultiPointZ,
                'PolyLine':ShpPolyLine,
                'PolyLineM':ShpPolyLineM,
                'PolyLineZ':ShpPolyLineZ,
                'Polygon':ShpPolygon,
                'PolygonM':ShpPolygonM,
                'PolygonZ':ShpPolygonZ,
                'MultiPatch':ShpMultiPatch
                }


class ShpFile(object):
    '''
This class is instantiated using the file path to a shapefile (must contain the .shp file extension), and as soon as it is instantiated, it reads the entire shapefile.
Once instantiated, it contains objects for each feature based on shape type (the objects are accessible using the
.records attribute), and allows access to the shapefile data at multiple levels.
'''

    def __init__(self,filePath):
        self.filePath = filePath
        self.proj = self._readProjText()
        self.dbfTable = self._readDbfTable()
        self.f = open(self.filePath, 'rb')
        header = self._readFileHeader()
        self.shapeType = header[0]
        self.boundingBox = header[1]
        self.records = self._readRecords()
        self.f.close()

    def _readBoundingBox(self):
        xMin = readAndUnpack('d', self.f.read(8))
        yMin = readAndUnpack('d', self.f.read(8))
        xMax = readAndUnpack('d', self.f.read(8))
        yMax = readAndUnpack('d', self.f.read(8))
        bbox = (xMin, yMin, xMax, yMax)
        return bbox

    def _readProjText(self):
        projPath = self.filePath[0:-4] + '.prj'
        f = open(projPath, 'r')
        s = f.read()
        return s


    def _readFileHeader(self):
        self.f.seek(32)
        shapeKey = readAndUnpack('i', self.f.read(4))
        shapeType = shapeTypeDict[shapeKey]
        boundingBox = self._readBoundingBox()
        return (shapeType, boundingBox)

    def _readPoint(self):
        x = readAndUnpack('d', self.f.read(8))
        y = readAndUnpack('d', self.f.read(8))
        return (x,y)

    def _readNumParts(self):
        return readAndUnpack('i', self.f.read(4))

    def _readNumPoints(self):
        return readAndUnpack('i', self.f.read(4))

    def _readParts(self, numParts):
        partIndices = []
        for i in range(numParts):
            partIndex = readAndUnpack('i', self.f.read(4))
            partIndices.append(partIndex)
        return partIndices

    def _readPoints(self, numPoints):
        points = []
        # I removed a short chunk of code here
        # that was used to remove any two identical
        # consecutive points. Such a check is only relevant if
        # each part is being checked separately, otherwise
        # a part that begins where the other left off would be
        # messed up.
        for i in range(numPoints):
            point = self._readPoint()
            points.append(point)
        return points

    def _readZ(self):
        z = readAndUnpack('d', self.f.read(8))
        return z

    def _readZBounds(self):
        zMin = self._readZ()
        zMax = self._readZ()
        return (zMin,zMax)

    def _readZArray(self, numPoints):
        zArray = []
        for i in range(numPoints):
            z = self._readZ()
            zArray.append(z)
        return zArray

    def setZfield(self, fieldKey=None, zValue=0.0):
        # this method will erase any existing
        # z data of the geometry
        # and will replace it with values
        # from the field designated
        # by the fieldKey
        zValue = 0.0
        for record in self.records:
            if fieldKey != None:
                try:
                    zValue = float(record.dbfData[fieldKey])
                except:
                    print 'There is no field by that name in the table'
                    return
            zArray = []
            for each in range(record.numPoints):
                zArray.append(zValue)
            record.make3D(zArray)

    def _readDbfTable(self):
        dbfFile = self.filePath[0:-4] + '.dbf'
        dbf = open(dbfFile, 'rb')
        db = list(dbfreader(dbf))
        dbf.close()
        return db

    def _readRecords(self):
        records = []
        self.f.seek(100)
        iterator = 0
        while True:
            record = self._readFeature(iterator)
            if record == False:
                    break
            records.append(record)
            iterator += 1
        return records

    def _readFeature(self, iterator):
        # the next 12 bytes are simply passed over, though they contain:
        # a record number: which doesn't seem to correspond to the dbf
        # a content length integer
        # a shapeType integer, which is never different form the shapeType of the file
        read = self.f.read(12)
        if read == '':
                # signifies end of shapefile
                return False
        else:
            # get shapeType and creates appropriate feature
            feature = classTypeDict[self.shapeType](self,iterator)
            return feature

##################################################

def addUserStrings(feature, geom):
    data = feature.dbfData
    for k in data:
        geom.SetUserString(k, str(data[k]))
    return geom

def tVect(geom, vector):
    geom.Translate(vector)
    geom.SetUserString('TranslationVector', str(vector) )
    return geom

def transVectorFromBBox(shpFile):
    """Uses the bounding box of a shapefile to make a vector moving Rhino geometry to the origin. The translation vector
    can also be stored as a user string the Rhino geometry, for later conversion back into geospatial data."""
    b = shpFile.boundingBox
    originalCenterPoint = ((b[0]+b[2])/2, (b[1]+b[3])/2, 0.0)
    translationVectr = Rhino.Geometry.Vector3d((b[0]+b[2])/-2.0, (b[1]+b[3])/-2.0, 0.0)
    return translationVectr

def chop(indices, someList):
    for i in range(len(indices)-1):
        idx1, idx2 = indices[i], indices[i+1]
        yield someList[idx1:idx2]

def chopPoints( feature ):
    if feature.numParts > 1:
        return [p for p in chop(feature.parts, feature.points3D)]
    else:
        return [feature.points3D]

def shpToPoints( feature, translationVector=None ):
    # You can't set user strings to Point3d so for now lets skip it.
    #points = [addUserStrings(feature, Rhino.Geometry.Point3d(*p)) for p in feature.points3D]
    points = [Rhino.Geometry.Point3d(p[0],p[1],p[2]) for p in feature.points3D]
    if translationVector:
        points = [p.Add(p, translationVector) for p in points]
    return points

def shpToCurve( feature, translationVector=None, degree=1):
    parts = chopPoints( feature )
    crvs = []
    for part in parts:
        points = []
        for pt in part:
            rhPoint = Rhino.Geometry.Point3d( *pt )
            points.append( rhPoint )
        crv = Rhino.Geometry.Curve.CreateControlPointCurve( points, degree )
        if translationVector:
            crv = tVect(crv, translationVector )
        crvs.append( addUserStrings(feature, crv) )
    return crvs

def shpToMesh( multiPatchFeature, translationVector=None ):
    m = multiPatchFeature
    parts = chopPoints(m)
    mesh = Rhino.Geometry.Mesh()
    for i, points in enumerate(parts):
        if m.partTypes[i] == 0: # it's a a triangle strip
            submesh = Rhino.Geometry.Mesh()
            for j, pt in enumerate(points): # build vertices
                rhPoint = Rhino.Geometry.Point3d(*pt)
                submesh.Vertices.Add(rhPoint)
            for n in range(len(points)-1):
                submesh.Faces.AddFace(n, n +1, n +2 )
            submesh.Normals.ComputeNormals()
            submesh.Compact()
            mesh.Append(submesh)
        else: # it's some other geometry
            return 'This geometry type is not yet supported, sorry.'
    mesh.UnifyNormals()
    mesh.Normals.ComputeNormals()
    mesh.Compact() # mesh all fresh and ready!
    if translationVector:
        mesh = tVect( mesh, translationVector)
    return [ addUserStrings(m, mesh) ]



translationDict = {
                   'Point':shpToPoints,
                   'Polygon':shpToCurve,
                   'PolyLine':shpToCurve,
                   'PolyLineZ':shpToCurve,
                   'PolygonZ':shpToCurve,
                   'MultiPatch':shpToMesh
                   }

def ShpFileToRhino( filepath, zero=True, tVect=None ):
    shpfile = ShpFile( filepath )
    if zero:
        tVect = transVectorFromBBox( shpfile )
    records = shpfile.records
    geoms = []
    for r in records:
        geoms.extend( translationDict[ shpfile.shapeType ]( r, tVect ) )
    return geoms

##################################################

if read:
    if shapefile:
        if not os.path.exists(shapefile):
            print 'The shapefile you gave me does not exist.\nDouble check the path: "%s"' % shapefile
        # import stuff
        out = ShpFileToRhino( shapefile, moveToCenter )
        print out
        geometry = out
    else:
        print 'no shapefile supplied'
# ---------- end readshapefile ----------
readshapefile_2 = ReadShapefile(shapefile=concat_2, read=Toggle(True))  # -> out, geometry; same code as readshapefile
readshapefile_3 = ReadShapefile(shapefile=concat_3, read=Toggle(True))  # -> out, geometry; same code as readshapefile
shpextractuserstrings = SHPExtractUserStrings(geometry=readshapefile_2.geometry)  # -> out, Attributes, Values; inputs geometry: GeometryBase
# ---------- shpextractuserstrings: Python ----------
if geometry:
    data = geometry.GetUserStrings()
    d = {}
    k = []
    v = []
    for u in data:
        k.append(u)
        d[u] = data[u]
        v.append(d[u])
    U = d
    Attributes = k
    Values = v
# ---------- end shpextractuserstrings ----------
shpextractuserstrings_2 = SHPExtractUserStrings(geometry=readshapefile_3.geometry)  # -> out, Attributes, Values; inputs geometry: GeometryBase; same code as shpextractuserstrings

# ---- group: Make Site and site Surface
# Select the parcel centroids, move them to their position in space according to the GIS values
# Get the attributes of the selected layers
panel = Panel("RASTERVALU")
mindex = MemberIndex(Set=shpextractuserstrings.Attributes, Member=panel)  # -> Index, Count
item = ListItem(List=shpextractuserstrings.Values, Index=mindex.Index, Wrap=False)
area = Area(Geometry=readshapefile_2.geometry)  # -> Area, Centroid
Z = UnitZ(Factor=item)
move = Move(Geometry=graft(area.Centroid), Motion=Z)  # -> Geometry, Transform
del = DelaunayMesh(Points=flatten(move.Geometry), Plane=PlaneXY(0, 0, 0))

# ---- group: Calculate slope
# Populate the site randomly with points, but only keep the points inside the site geometry
# Intersect the points with the site mesh and get their Z value
# Evaluate the angle between the normals of the site mesh and an XY plane to obtain the surface slope
# Color the points according to slope
slider = Slider(1, range=0..10)
item_2 = ListItem(List=readshapefile.geometry, Index=slider, Wrap=False)
geo = Geometry(item_2)
pop2d = Populate2D(Region=geo, Count=Slider(200, range=0..1000), Seed=1)
Z_2 = UnitZ(Factor=1)
meshray = MeshRay(Mesh=del, Point=pop2d, Direction=Z_2)  # -> Point, Hit
meshcp = ClosestPoint(Point=meshray.Point, Mesh=del)  # -> Point, Index, Parameter
meval = MeshEval(Mesh=del, Parameter=meshcp.Parameter)  # -> Point, Normal, Colour
xy = XYPlane(Origin=Point(0, 0, 0))
angle = Angle(VectorA=meval.Normal, VectorB=xy)  # -> Angle, Reflex
bnd = Bounds(Numbers=angle.Angle)
domcomp = DomainComponents(Domain=bnd)  # -> Start, End
gradient = Gradient(
    LowerLimit=domcomp.Start,
    UpperLimit=domcomp.End,
    Parameter=angle.Angle,
    stops=[0.15: RGB(255, 130, 160), 0.85: RGB(220, 0, 40)])
preview = CustomPreview(Geometry=meval.Point, Shader=gradient)

# ----
# Get the height value in ft
# Since all the geometry is scaled in meters, we need to convert the ft value to meters
panel_2 = Panel("RASTERVALU")
geo_2 = Geometry(graft(readshapefile_3.geometry))
mindex_2 = MemberIndex(Set=shpextractuserstrings_2.Attributes, Member=panel_2)  # -> Index, Count
item_3 = ListItem(List=shpextractuserstrings_2.Values, Index=mindex_2.Index, Wrap=False)
multiplication = Multiplication(A=item_3, B=Slider(0.3048, range=0..1))
Z_3 = UnitZ(Factor=multiplication)
extr = Extrude(Base=geo_2, Direction=Z_3)
cap = CapHoles(Brep=extr)

# ---- group: shot walk in site
# Populate the site randomly with points, but only keep the points inside the site geometry
# Create a delaunay tesselation between all points
# Intersect the points with the site mesh and get their Z value
# Sort the points' Z value and select the highest and lowest point in site
# Make a stright line between lowest and highest point in site
slider_2 = Slider(200, range=0..1000)
site = Geometry(geo)
mesh = Mesh(del)
pop2d_2 = Populate2D(Region=site, Count=slider_2, Seed=1)
con = Containment(Point=pop2d_2, Curve=site)  # -> Relationship, Point
Z_4 = UnitZ(Factor=1)
cull = CullPattern(List=pop2d_2, CullPattern=con.Relationship)
meshray_2 = MeshRay(Mesh=mesh, Point=cull, Direction=Z_4)  # -> Point, Hit
pcomp = Decompose(Point=meshray_2.Point, System=PlaneXY(0, 0, 0))  # -> XComponent, YComponent, ZComponent
sort = SortList(Keys=pcomp.ZComponent, ValuesA=meshray_2.Point)  # -> Keys, ValuesA
item_4 = ListItem(List=reverse(sort.ValuesA), Index=0, Wrap=False)
item_5 = ListItem(List=sort.ValuesA, Index=0, Wrap=False)
ln = Line(StartPoint=item_5, EndPoint=item_4)
con_2 = DelaunayEdges(Points=meshray_2.Point, Plane=PlaneXY(0, 0, 0))  # -> Connectivity, Edges

# ---- group: create site contours
# Create a bbox around the site mesh, and get the lowest vertice of the box to use as a starting point of the site contours
bbox = BoundingBox(Content=del, Plane=PlaneXY(0, 0, 0))  # -> Box, Box_2
explode = BrepComponents(Brep=bbox.Box)  # -> Faces, Edges, Vertices
pcomp_2 = Decompose(Point=explode.Vertices, System=PlaneXY(0, 0, 0))  # -> XComponent, YComponent, ZComponent
sort_2 = SortList(Keys=pcomp_2.ZComponent, ValuesA=explode.Vertices)  # -> Keys, ValuesA
item_6 = ListItem(List=sort_2.ValuesA, Index=0, Wrap=False)
contour = Contour(Shape=del, Point=item_6, Direction=Vector(0, 0, 1), Distance=Slider(0.1, range=0..1))

# ----
# Intersect building centroids with a site mesh, create a movement vector and move the buildings to their actual location in space.
area_2 = Area(Geometry=geo_2)  # -> Area, Centroid
Z_5 = UnitZ(Factor=1)
meshray_3 = MeshRay(Mesh=del, Point=area_2.Centroid, Direction=Z_5)  # -> Point, Hit
vec2pt = Vector2Pt(PointA=area_2.Centroid, PointB=meshray_3.Point, Unitize=False)  # -> Vector, Length
move_2 = Move(Geometry=cap, Motion=vec2pt.Vector)  # -> Geometry, Transform

# ---- group: drainage
# Get the highest points on site and get their drainage paths.
pcomp_3 = Decompose(Point=meshray.Point, System=PlaneXY(0, 0, 0))  # -> XComponent, YComponent, ZComponent
slider_3 = Slider(4, range=0..10)
sort_3 = SortList(Keys=pcomp_3.ZComponent, ValuesA=meshray.Point)  # -> Keys, ValuesA
surface_maker = SurfaceMaker(M=del, C=geo)
high_points = SubList(List=reverse(sort_3.ValuesA), Domain=slider_3, Cycle=False)  # -> List, Index

# ----
lng = ListLength(List=sort_3.ValuesA)
random = Random(Range=lng, Number=slider_3, Seed=2, Integers=True)
item_7 = ListItem(List=sort_3.ValuesA, Index=random, Wrap=True)

# ---- group: drainage (continued)
python = PythonScript(
    startPoint=item_7,
    terrainSurface=surface_maker,
    stepSize=Slider(0.5, range=0..10),
    maxSteps=Slider(1000, range=0..1000),
    tol=Slider(0.1, range=0..1),
    climb=Toggle(True))  # -> out, a; inputs startPoint: Point3d, terrainSurface: Surface
# ---------- python: Python ----------
import Rhino
 
class Crawler():
    def __init__(self, point3d, surface, stepsize=0.5, maxsteps=None, tolerance=0.001, climb=False):
        self.start = point3d
        self.pos = self.start
        result, self.u, self.v = surface.ClosestPoint(self.pos)
        self.surface = surface
        self.stepsize = stepsize
        self.points = [self.start]
        self.state = 'on'
        self.tolerance = tolerance
        self.maxsteps = maxsteps
     
    def makeDrainCurve(self):
        i = 0
        while self.state == 'on':
            i += 1
            if self.maxsteps:
                if i >= self.maxsteps:
                    self.state = 'finished'
            self.nextStep()
        return Rhino.Geometry.Curve.CreateControlPointCurve(self.points, 1)
         
    def nextStep(self):
        result, newFrame = self.surface.FrameAt(self.u, self.v)
        # create a vector from newFrame XAxis
        downVect = newFrame.XAxis
        # figure out hw far to rotate it.
        deltaAngle = Rhino.Geometry.Vector3d.VectorAngle( downVect, Rhino.Geometry.Vector3d(0.0, 0.0, -1.0), newFrame )
        if climb: deltaAngle = Rhino.Geometry.Vector3d.VectorAngle( downVect, Rhino.Geometry.Vector3d(0.0, 0.0, 1.0), newFrame )
        # rotate it in the plane
        downVect.Rotate( deltaAngle, newFrame.ZAxis)
        # set the length
        downVect = downVect.Multiply( self.stepsize, downVect )
        spacePoint = Rhino.Geometry.Point3d.Add(self.pos, downVect)
        result, self.u, self.v = self.surface.ClosestPoint(spacePoint)
        out, newPoint, vects = self.surface.Evaluate(self.u, self.v, 0)
        if climb:
            if newPoint.Z <= self.pos.Z: # if higher
                self.state = 'finished'
        else:
            if newPoint.Z >= self.pos.Z: # if higher
                self.state = 'finished'
        if not self.checkTolerance(newPoint): # if too close
            self.state = 'finished'
        else:
            self.updatePos( newPoint )
     
    def updatePos(self, newPoint):
        self.points.append(newPoint)
        self.pos = newPoint
     
    def checkTolerance(self, other):
        # checks against another point
        # if it is outside of tolerance, returns True
        return self.pos.DistanceTo( other ) > self.tolerance
 
if terrainSurface:
    b = Crawler(startPoint, terrainSurface, stepSize, maxSteps, tol,climb)
    a = b.makeDrainCurve()
# ---------- end python ----------

# ==== cluster SurfaceMaker
C = ClusterInput()
M = ClusterInput()

# ---- group: site suface
# Create a nurbs surface wit the points, the number of points in u is always going to be U+1
# Intersect the points with the mesh to get their exact position in space
# Create a bounding box around the site. Get the U and V domains and create a new domain with their values
# Create points for every value in the list
# Subdivide the domain into a smaller sample of points
bbox = BoundingBox(Content=C, Plane=PlaneXY(0, 0, 0))  # -> Box, Box_2
explode = BrepComponents(Brep=bbox.Box)  # -> Faces, Edges, Vertices
pcomp = Decompose(Point=explode.Vertices, System=PlaneXY(0, 0, 0))  # -> XComponent, YComponent, ZComponent
sort = SortList(Keys=pcomp.YComponent)  # -> Keys, ValuesA
sort_2 = SortList(Keys=pcomp.XComponent)  # -> Keys, ValuesA
item = ListItem(List=reverse(sort.Keys), Index=0, Wrap=False)
item_2 = ListItem(List=reverse(sort_2.Keys), Index=0, Wrap=False)
item_3 = ListItem(List=sort.Keys, Index=0, Wrap=False)
item_4 = ListItem(List=sort_2.Keys, Index=0, Wrap=False)
subtraction = Subtraction(A=item, B=item_3)
dom = Domain(DomainStart=item_3, DomainEnd=item)
subtraction_2 = Subtraction(A=item_2, B=item_4)
dom_2 = Domain(DomainStart=item_4, DomainEnd=item_2)
division = Division(A=subtraction, B="4")
division_2 = Division(A=subtraction_2, B="4")
range = Range(Domain=dom_2, Steps=division_2)
range_2 = Range(Domain=dom, Steps=division)
addition = Addition(A=division_2, B="1")
crossref = CrossReference(ListA=range, ListB=range_2, CrossMode=1)  # -> ListA, ListB
Z = UnitZ(Factor=1)
pt = PointXYZ(XComponent=crossref.ListA, YComponent=crossref.ListB, ZComponent=0, System=PlaneXY(0, 0, 0))

# ----
sort_pt = SortPoints(Points=pt)  # -> Points, Indices

# ---- group: site suface (continued)
meshray = MeshRay(Mesh=M, Point=sort_pt.Points, Direction=Z)  # -> Point, Hit
srfgrid = SurfaceFromPoints(Points=meshray.Point, UCount=addition, Interpolate=False)

# ----
S = ClusterOutput(srfgrid)
