# Grasshopper definition local_agent2.gh (Grasshopper 0.9.14)
# plug-ins: Python Interpreter, Decodes Python Interpreter

# ---- group: create flock
bird_count = Slider(10, range=3..200)
max_frc = Slider(0.35, range=0..1)
max_vel = Slider(2, range=0..6)

# ----
geo = Geometry([Point(-14.3712828, -4.930870607, 12.0895825), Point(-5.130121158, 20.09673326, 12.08999513), Point(-10.12020527, -28.30059211, 12.09074373), Point(24.17899465, 17.64733731, 12.09075812), Point(8.785331444, -12.64188333, 12.09187436)])
geo_2 = Geometry(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)
pull = PullPoint(Point=geo, Geometry=geo_2, Closest=True)  # -> ClosestPoint, Distance
python = PythonScript(
    startPoint=pull.ClosestPoint,
    terrainSurface=geo_2,
    stepSize=Slider(0.5, range=0..10),
    maxSteps=Slider(1000, range=0..1000),
    tol=Slider(0.1, range=0..1),
    climb=Toggle(False))  # -> out, a; inputs startPoint: Point3d, terrainSurface: Surface
# ---------- python: Python ----------
from local_agent import *

if climb == None:
    climb = False
    
if terrainSurface:
    crawler = Crawler(startPoint, terrainSurface, stepSize, maxSteps, tol,climb)
    a = crawler.makeDrainCurve()
# ---------- end python ----------

data = Data([Point(-0.6919195345, -13.32472867, 7.1008), Point(4.590949512, -5.954757487, 7.1008), Point(-1.921249717, -13.19852085, 7.1008), Point(1.920382092, -9.893712091, 7.1008), Point(13.86373166, 0.2360594422, 7.1008), Point(-8.215864863, 10.65437823, 7.1008), Point(9.345345649, 2.807939382, 7.1008), Point(7.993223088, -0.8980376506, 7.1008), Point(6.507625958, -3.090370098, 7.1008)])

# ---- group: create flock
bird_count_2 = Slider(10, range=3..30)
rov = Slider(60, range=0.5..60)
max_frc_2 = Slider(0.3, range=0..1)
max_vel_2 = Slider(6, range=0..6)
roc = Slider(15, range=0.5..30)

# ----
data_2 = Data([Point(5.728116924, 2.991015286, 7.1008), Point(2.654274234, 2.467992865, 7.1008), Point(5.495646838, 4.30366239, 7.1008), Point(-4.44868188, -3.978414436, 7.1008), Point(0.4519141093, 6.101478938, 7.1008), Point(1.394050781, -5.322210068, 7.1008), Point(-2.5310175, 7.056061633, 7.1008), Point(-6.259086736, 6.463417994, 7.1008)])
data_3 = Data(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)
clean = CleanTree(Data=data_2, CleanInvalid=True, CleanEmpty=False)
dla = PythonScript(
    container=data_3,
    points=clean,
    repel=flatten(data),
    percent_back=Slider(0, range=0..1),
    iter_num=Slider(3, range=0..10),
    particle_num=Slider(4, range=0..10),
    max_length=Slider(0.2, range=0..1),
    activate=Toggle(True))  # -> out, boids, trails; inputs points: list, repel: list, iter_num: Int32
# ---------- dla: Python ----------
from local_agent import *
import random

random.seed(0)
    
def Main():
    # Make a geometry to contain the DLAs
    #get some points to make the lda starting points
    ptGUIDs = points
    attractorGUIDs = repel
    attractors = []
    for attrGUID in attractorGUIDs:
        attractors.append(rs.PointCoordinates(attrGUID))
    myDlaPts = []
    for ptGUID in ptGUIDs:
        # Add the initial agent points
        coord = rs.PointCoordinates(ptGUID)
        #index = rs.PointArrayClosestPoint(attractors,coord)
        #dist = rs.Distance(coord, attractors[index])
        myDlaPts.append( DLA(coord, ptGUID, max_length, percent_back))
    for i in range(iter_num):
        newDlaPts = []
        for myDlaPt in myDlaPts:
            tempList = myDlaPt.aggregate(int(particle_num), 5, myDlaPts, attractors)
            for pt in tempList:
                try:
                    faces = rs.ExplodePolysurfaces(container)
                    for face in faces:
                        other_att = rs.EvaluateSurface(face, rs.SurfaceClosestPoint(face,pt.id)[0],rs.SurfaceClosestPoint(face,pt.id)[1])
                        attractors.append(other_att)
                    ############################
                    # I should create a method to only keep the points and geometries inside the box
                    # Maybe instead of deleting whatever is outside, I can give it another vector of rotation...
                except:
                    pass
            
            if tempList != "empty":
                newDlaPts.extend( tempList )
        myDlaPts.extend(newDlaPts)
    return myDlaPts

if __name__=="__main__":
    if activate == True:
        agents = Main()
        boids = []
        trails = [ ]
        pt = []
        print agents
        for i in agents:
            boids.append(i.id)
            trails.append(i.line)
# ---------- end dla ----------

# ---- group: create flock
decodes = DecodesPythonScript(count=bird_count, max_frc=max_frc, max_vel=max_vel)  # -> console, a; inputs count: Int32, start_pos: list, start_vec: list of Line
# ---------- decodes: Python ----------
import math
from local_agent import *

random.seed(0)

if count == None:
    count = 10
if not rov:
    rov = None
if not roc:
    roc = None
    
flock = []
if len(start_pos)>0:
    # look through list of start points (velocity will be random)
    for pt in start_pos:
        flock.append(Loc_Agent(max_frc, max_vel, rov, roc, pos_start = pt))
else:
    for n in range(count): 
        flock.append(Loc_Agent(max_frc, max_vel, rov, roc, pos_start = Point(0,0)))

if len(start_vec)>0:
    # look through list of segments (start_vel)
    for seg in start_vec: 
        pt = seg.spt
        vec = Vec(pt, seg.ept)
        if vec.length > max_vel:
            max_vel = vec.length
            max_frc = max_vel/2
        flock.append(Loc_Agent(max_frc, max_vel, rov, roc, pos_start = pt, vel_start = vec))

for bird in flock: 
    bird.reset()
    bird.max_frc = max_frc
    bird.max_vel = max_vel
    bird.rov = rov
    bird.roc = roc

a.put(flock)
# ---------- end decodes ----------

rov_2 = Slider(50, range=0.5..100)
max_frc_3 = Slider(1, range=0..1)
max_vel_3 = Slider(1, range=0..6)
roc_2 = Slider(5, range=0.5..30)

# ----
geo_3 = Geometry(dla.trails)
geo_4 = Geometry(dla.boids)

step_count = Slider(20, range=5..100)
decodes_2 = DecodesPythonScript(count=bird_count_2, max_frc=max_frc_2, max_vel=max_vel_2, rov=rov, roc=roc)  # -> console, a; inputs count: Int32, start_pos: list, start_vec: list of Line; same code as decodes
decodes_3 = DecodesPythonScript(flock=decodes_2.a, steps=step_count, seek=Slider(3, range=0..3), align=Slider(1, range=0..3), flee=Slider(2, range=0..3))  # -> console, a; inputs flock: list, steps: Int32, att: list, rep: list
# ---------- decodes_3: Python ----------
'''
4.02.L05d
Move a flock of simple Birds using the Flocking algorithm

required:
flock ([Bird]) A group of Bird objects
steps (int) The number of steps
align, seek, flee (float) The relative strength of the align, seek and flee behaviors 

result:
flock ([Bird]) A group of Birds with their history filled out
'''
from local_agent import *
"""
Move a group of Birds as a flock
"""
bird_behaviors = seek+align+flee


# set up weighting
if behavior:
    env_weight = (behavior + 1)/2.0
    flocking_weight = 1.0 - env_weight
    seek = flocking_weight * seek/bird_behaviors
    align = flocking_weight * align/bird_behaviors
    flee = flocking_weight * flee/bird_behaviors

# for each time step:
for step in range(steps):
    # establish a searchable "sky" 
    sky = QuadAgent.encompass(pts = flock)
    
    # for each Bird in the flock:
    for bird in flock:
        # if this is the first step:
        if step == 0:
            # reset the Bird's history
            bird.reset()
        # find Birds within range of vision
        nears = bird.scan(sky)
        # steer Bird to align with nearby Birds
        bird.align(nears, align)
        # steer Bird toward nearby Birds
        bird.seek(nears, seek)
        # find Birds within the range of comfort
        too_nears = bird.in_range(nears, bird.roc)
        # steer Bird to flee
        bird.flee(too_nears, flee)
        # steer / flee from attractors/repulsors
        if len(att) > 0 and len(rep) > 0:
            bird.attractor(att, rep, env_weight)
        # update Bird
        bird.step()

a.put(flock)
# ---------- end decodes_3 ----------
step = Slider(0, range=0..100)
decodes_4 = DecodesPythonScript(flock=decodes_3.a)  # -> console, a; inputs flock: list
# ---------- decodes_4: Python ----------
for bird in flock: a.put(PLine(bird.hist_pos))
# ---------- end decodes_4 ----------

# ---- group: draw birds at given step
decodes_5 = DecodesPythonScript(flock=decodes_3.a, step=step)  # -> console, a, b, c, d, e; inputs flock: list, step: Int32
# ---------- decodes_5: Python ----------
max_step = len(flock[0].hist_pos)
step = step%max_step

for bird in flock:
    pos = bird.hist_pos[-1]
    vel = bird.hist_vel[-1]
    acl = bird.hist_acl[-1]
    if step < len(bird.hist_pos):
        pos = bird.hist_pos[step]
        vel = bird.hist_vel[step]
        acl = bird.hist_acl[step]
    a.put(pos)
    b.put(vel)
    c.put(acl)
    d.put(Circle(Plane(pos,Vec(0,0,1)),bird.rov))
    e.put(Circle(Plane(pos,Vec(0,0,1)),bird.roc))
# ---------- end decodes_5 ----------

# ----
runion = RegionUnion(Curves=decodes_5.e)
runion_2 = RegionUnion(Curves=decodes_5.d)
vdis = VectorDisplay(Anchor=decodes_5.a, Vector=decodes_5.b)
vdis_2 = VectorDisplay(Anchor=decodes_5.a, Vector=decodes_5.c)

number_slider = Slider(8, range=0..100)
dom = ConstructDomain(DomainStart=0, DomainEnd=Slider(20, range=0..100))
random = Random(Range=dom, Number=number_slider, Seed=Slider(5, range=0..10))
random_2 = Random(Range=dom, Number=number_slider, Seed=2)
step_count_2 = Slider(30, range=5..1000)
pt = ConstructPoint(XCoordinate=random_2, YCoordinate=random, ZCoordinate=0)
geo_5 = Geometry([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])
geo_6 = Geometry()
geo_7 = Geometry(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)
decodes_6 = DecodesPythonScript(start_pos=pt, start_vec=geo_5, max_frc=max_frc_3, max_vel=max_vel_3, rov=rov_2, roc=roc_2)  # -> console, a; inputs count: Int32, start_pos: list, start_vec: list of Line; same code as decodes
step_2 = Slider(31, range=0..1000)

# ---- group: move flock
decodes_7 = DecodesPythonScript(
    flock=decodes_6.a,
    steps=step_count_2,
    seek=Slider(1, range=0..3),
    align=Slider(1, range=0..3),
    flee=Slider(4, range=0..10),
    behavior=Slider(0.1, range=-1..1),
    att=geo_6,
    rep=geo_7)  # -> console, a; inputs flock: list, steps: Int32, att: list, rep: list
# ---------- decodes_7: Python ----------
'''
4.02.L05d
Move a flock of simple Birds using the Flocking algorithm

required:
flock ([Bird]) A group of Bird objects
steps (int) The number of steps
align, seek, flee (float) The relative strength of the align, seek and flee behaviors 

result:
flock ([Bird]) A group of Birds with their history filled out
'''
from local_agent import *
"""
Move a group of Birds as a flock
"""
bird_behaviors = seek+align+flee


# set up weighting

if behavior:
    env_weight = (behavior + 1)/2.0
    flocking_weight = 1.0 - env_weight
    seek = flocking_weight * seek/bird_behaviors
    align = flocking_weight * align/bird_behaviors
    flee = flocking_weight * flee/bird_behaviors

# for each time step:
for step in range(steps):
    # establish a searchable "sky" 
    sky = QuadAgent.encompass(pts = flock)
    
    # for each Bird in the flock:
    for bird in flock:
        # if this is the first step:
        if step == 0:
            # reset the Bird's history
            bird.reset()
        # find Birds within range of vision
        nears = bird.scan(sky)
        # steer Bird to align with nearby Birds
        bird.align(nears, align)
        # steer Bird toward nearby Birds
        bird.seek(nears, seek)
        # find Birds within the range of comfort
        too_nears = bird.in_range(nears, bird.roc)
        # steer Bird to flee
        bird.flee(too_nears, flee)
        # steer / flee from attractors/repulsors
        if len(att) > 0 and len(rep) > 0:
            bird.attractor(att, rep, env_weight)
        # update Bird
        bird.step()

a.put(flock)
# ---------- end decodes_7 ----------

# ---- group: draw bird trails
decodes_8 = DecodesPythonScript(flock=decodes_7.a)  # -> console, a; inputs flock: list; same code as decodes_4

# ---- group: draw birds at given step
decodes_9 = DecodesPythonScript(flock=decodes_7.a, step=step_2)  # -> console, a, b, c, d, e; inputs flock: list, step: Int32; same code as decodes_5

# ----
vdis_3 = VectorDisplay(Anchor=decodes_9.a, Vector=decodes_9.c)
vdis_4 = VectorDisplay(Anchor=decodes_9.a, Vector=decodes_9.b)
runion_3 = RegionUnion(Curves=decodes_9.d)
runion_4 = RegionUnion(Curves=decodes_9.e)

close_enough = Slider(1.25, range=0.1..3)
step_count_3 = Slider(100, range=5..100)
md_slider = MDSlider(
    slider_value=Point(0.8663377762, 0.9187507629, 0.5),
    x_domain=Domain(-30, 30),
    y_domain=Domain(-30, 30),
    z_domain=Domain(0, 1),
    SliderMode=0)
goal_pt = Point(md_slider)

# ---- group: move flock
decodes_10 = DecodesPythonScript(flock=decodes.a, goal_pt=goal_pt, close_enough=close_enough, count=step_count_3)  # -> console, a; inputs flock: list, count: Int32
# ---------- decodes_10: Python ----------
'''
4.02.L05b
Move a flock of simple Birds toward a goal.

required:
flock ([Bird]) A group of Bird objects
goal_pt (Point) The point that the flock will seek
close_enough (float) The distance from the goal that will cause Bird to stop
count (int) The number of steps 

result:
flock ([Bird]) A group of Birds with their history filled out
'''

"""
Move a flock of simple Birds toward a goal
"""
# for each time step:
for step in range(count):
    # for each Bird in the flock:
    for bird in flock:
        # if this is the first step:
        if step == 0:
            # reset the Bird's history
            bird.reset()
        # create a steering vector
        vec = Vec(bird.pos,goal_pt)
        # if Bird is not close to goal point:
        if vec.length > close_enough : 
            # steer bird toward goal and update
            bird.steer( vec - bird.vel )
            bird.step()

a.put(flock)
# ---------- end decodes_10 ----------

# ---- group: draw birds at given step
decodes_11 = DecodesPythonScript(flock=decodes_10.a, step=Slider(0, range=0..100))  # -> console, a, b, c; inputs flock: list, step: Int32
# ---------- decodes_11: Python ----------
print len(flock)
print len(flock[0].hist_pos)

max_step = len(flock[0].hist_pos)
step = step%max_step

print max_step

for bird in flock:
    pos = bird.hist_pos[-1]
    vel = bird.hist_vel[-1]
    acl = bird.hist_acl[-1]
    if step < len(bird.hist_pos):
        pos = bird.hist_pos[step]
        vel = bird.hist_vel[step]
        acl = bird.hist_acl[step]
    a.put(pos)
    b.put(vel)
    c.put(acl)
# ---------- end decodes_11 ----------

# ---- group: draw bird trails
decodes_12 = DecodesPythonScript(flock=decodes_10.a)  # -> console, a; inputs flock: list; same code as decodes_4

# ----
vdis_5 = VectorDisplay(Anchor=decodes_11.a, Vector=decodes_11.c)
vdis_6 = VectorDisplay(Anchor=decodes_11.a, Vector=decodes_11.b)
